# Grasshopper definition Massing Design Calculator 0.6.1.gh (Grasshopper 1.0.7)
# plug-ins: Human

rent_per_sf = DigitScroller(Scroller_Digits=12, Scroller_Prefix="Rent Per SF", Scroller_Radix=10, Scroller_Value=2.8)
soft_costs = DigitScroller(Scroller_Digits=12, Scroller_Prefix="Soft Costs", Scroller_Radix=11, Scroller_Value=30)
building_size = DigitScroller(Scroller_Digits=12, Scroller_Prefix="Building Size", Scroller_Radix=11, Scroller_Value=2696)
purcase_price = DigitScroller(Scroller_Digits=12, Scroller_Prefix="Purcase Price", Scroller_Radix=11, Scroller_Value=559000)
cap_rate = DigitScroller(Scroller_Digits=12, Scroller_Prefix="Cap Rate", Scroller_Radix=11, Scroller_Value=5)
sale_per_sf = DigitScroller(Scroller_Digits=12, Scroller_Prefix="Sale Per SF", Scroller_Radix=11, Scroller_Value=516)
construction_cost_per_sf = DigitScroller(Scroller_Digits=12, Scroller_Prefix="Construction Cost Per SF", Scroller_Radix=11, Scroller_Value=95)
net_gross_coef = DigitScroller(Scroller_Digits=12, Scroller_Prefix="Net / Gross Coef", Scroller_Radix=11, Scroller_Value=70)
occupancy_rate = DigitScroller(Scroller_Digits=12, Scroller_Prefix="Occupancy Rate", Scroller_Radix=11, Scroller_Value=90)
python = GhPythonScript(
    building_size=building_size,
    purchase_price=purcase_price,
    cap_rate=cap_rate,
    rpsf=rent_per_sf,
    ppsf=sale_per_sf,
    cpsf=construction_cost_per_sf,
    hard_soft_coef=soft_costs,
    net_coef=net_gross_coef,
    occupancy_rate=occupancy_rate)  # -> values_proforma, values_assumptions
# ---------- python: Python ----------
__author__ = "ilouh"
__version__ = "2023.02.21"

import rhinoscriptsyntax as rs
import Grasshopper as gh
import Rhino.Geometry as rg
import ghpythonlib.components as comps
import math


def format_to_dollar_price(value):
    if isinstance(value, (int, float)):
        formatted_value = "${:,.2f}".format(value)
    elif isinstance(value, str):
        # Remove any non-numeric characters
        value = ''.join(filter(str.isdigit, value))
        if value:
            formatted_value = "${:,.2f}".format(float(value)/100)
        else:
            formatted_value = "$0.00"
    else:
        raise TypeError("Unsupported value type. Only int, float, and str are supported.")
    
    return formatted_value

def float_to_percentage(number):
    percentage = number * 100
    formatted_percentage = "{:.2f}%".format(percentage)
    return formatted_percentage

def format_to_sf_area(value):
    if isinstance(value, (int, float)):
        formatted_value = "{:,.2f} SF".format(value)
    else:
        raise TypeError("Unsupported value type. Only int and float are supported.")
    
    return formatted_value

#_______________________________________________________________________________________
# Calculations

construction_cost = building_size * cpsf
soft_cost = construction_cost * (hard_soft_coef / 100)
total_project_cost = purchase_price + construction_cost + soft_cost
monthly_rent = float(rpsf) * building_size * (occupancy_rate/100)
annual_rent = monthly_rent * 12
gross_income = annual_rent
net_income = annual_rent * (net_coef / 100)
valuation = (net_income / (cap_rate / 100))
future_cap_rate = net_income / total_project_cost
sale_value = building_size * ppsf
profit = sale_value - total_project_cost
profit_margin = (sale_value - total_project_cost) / total_project_cost

dict_proforma = {
    'building_size': format_to_sf_area(building_size),
    'purchase_price': format_to_dollar_price(purchase_price),
    'construction_cost': format_to_dollar_price(construction_cost),
    'soft_cost': format_to_dollar_price(soft_cost),
    'total_project_cost': format_to_dollar_price(total_project_cost),
    'monthly_rent': format_to_dollar_price(monthly_rent),
    'gross_income': format_to_dollar_price(gross_income),
    'net_income': format_to_dollar_price(net_income),
    'valuation': format_to_dollar_price(valuation),
    'future_cap_rate': float_to_percentage(future_cap_rate),
    'sale_value': format_to_dollar_price(sale_value),
    'profit': format_to_dollar_price(profit),
    'profit_margin': float_to_percentage(profit_margin)
}

dict_assumptions = {

    "cap_rate": float_to_percentage(cap_rate / 100),
    "rent_per_sf": format_to_dollar_price(rpsf),
    "price_per_sf": format_to_dollar_price(ppsf),
    "construction_price_per_sf": format_to_dollar_price(cpsf),
    "soft_cost_allowance": float_to_percentage(hard_soft_coef / 100),
    "net_rental_coef": float_to_percentage(net_coef / 100),
    "occupancy_rate": float_to_percentage(occupancy_rate / 100)
}


keys_list_proforma = [

    'building_size',
    'purchase_price',
    'construction_cost',
    'soft_cost',
    'total_project_cost',
    'monthly_rent',
    'gross_income',
    'net_income',
    'valuation',
    'future_cap_rate',
    'sale_value',
    'profit',
    'profit_margin'


]

keys_list_assumptions = [

    "cap_rate",
    "rent_per_sf",
    "price_per_sf",
    "construction_price_per_sf",
    "soft_cost_allowance",
    "net_rental_coef",
    "occupancy_rate"
]


# Iterate through the keys_list and retrieve corresponding values from the data_dict
values_proforma = []
values_assumptions = []

for item in keys_list_proforma:
    values_proforma.append(item + ': ' + str(dict_proforma[item]))

for item in keys_list_assumptions:
    values_assumptions.append(item + ': ' + str(dict_assumptions[item]))
# ---------- end python ----------
panel = Panel("""1
4""")
panel_2 = Panel("""1
5
8
10""")
ins = InsertItems(List=python.values_proforma, Indices=panel_2, Wrap=True)
ins_2 = InsertItems(List=python.values_assumptions, Indices=panel, Wrap=True)
panel_3 = Panel(ins_2)
panel_4 = Panel(ins)

rent_per_sf_2 = DigitScroller(Scroller_Digits=12, Scroller_Prefix="Rent Per SF", Scroller_Radix=10, Scroller_Value=4.45)
land_value = DigitScroller(Scroller_Digits=12, Scroller_Prefix="Land Value", Scroller_Radix=11, Scroller_Value=2200000)
hard_vs_soft_coef = DigitScroller(Scroller_Digits=12, Scroller_Prefix="Hard vs Soft Coef", Scroller_Radix=11, Scroller_Value=70)
construction_cost_per_sf_2 = DigitScroller(Scroller_Digits=12, Scroller_Prefix="Construction Cost Per SF", Scroller_Radix=11, Scroller_Value=375)
sale_price_per_sf = DigitScroller(Scroller_Digits=12, Scroller_Prefix="Sale Price Per SF", Scroller_Radix=11, Scroller_Value=975)
cap_rate_2 = DigitScroller(Scroller_Digits=12, Scroller_Prefix="Cap Rate", Scroller_Radix=11, Scroller_Value=5)
net_coefficient = DigitScroller(Scroller_Digits=12, Scroller_Prefix="Net Coefficient", Scroller_Radix=11, Scroller_Value=70)

# ---- group: Load location of json File
path = FilePath("C:\Users\ilouh\Documents\GitHub\Integrated\data.json")

# ---- group: uses the file name as a an address
c_script = CSharpScript()  # -> A
# ---------- c_script: C# ----------
A = RhinoDocument.Path;
# ---------- end c_script ----------
python_2 = GhPythonScript(path=c_script, json_file_path=path)  # -> address
# ---------- python_2: Python ----------
__author__ = "iliyamuzychuk"

import rhinoscriptsyntax as rs
import re

#path = "/Volumes/GoogleDrive/My Drive/Layouts/2104 S Cochran.3dm"

pattern = r"/(\d+\s[A-Za-z\s]+)\.\w+"  # Regex pattern to match the desired text

match = re.search(pattern, path)

if match:
    address = match.group(1)
    
else:
    print("No match found")
    

import json


with open(json_file_path) as f:
    data = json.load(f)

data['json_schema']['general_information']['address'] = address

#save the json file
with open(json_file_path, 'w') as outfile:
    json.dump(data, outfile)
# ---------- end python_2 ----------

# ---- group: Import Mass as PolySurface
massing = Brep(simplify(graft([<brep referenced from the Rhino model> x8])))

# ----
_1st_stack_floor_height = DigitScroller(Scroller_Digits=12, Scroller_Prefix="1st Stack Floor Height", Scroller_Radix=11, Scroller_Value=0)
no_of_floors = DigitScroller(Scroller_Digits=12, Scroller_Prefix="No. Of Floors", Scroller_Radix=11, Scroller_Value=0)
_2nd_stack_floor_height = DigitScroller(Scroller_Digits=12, Scroller_Prefix="2nd Stack Floor Height", Scroller_Radix=11, Scroller_Value=0)
no_of_floors_2 = DigitScroller(Scroller_Digits=12, Scroller_Prefix="No. Of Floors", Scroller_Radix=11, Scroller_Value=0)
typical_floor_height = DigitScroller(Scroller_Digits=12, Scroller_Prefix="Typical Floor Height", Scroller_Radix=11, Scroller_Value=10)
omit_last_floor_slab = BooleanToggle(False)

construction_cost_per_sf_parking = DigitScroller(Scroller_Digits=12, Scroller_Prefix="Construction Cost Per SF Parking", Scroller_Radix=11, Scroller_Value=125)
total_parking_area = DigitScroller(Scroller_Digits=12, Scroller_Prefix="Total Parking Area", Scroller_Radix=11, Scroller_Value=6000)
python_3 = GhPythonScript(
    hard_soft_coef=hard_vs_soft_coef,
    costruction_costs_per_sf=construction_cost_per_sf_2,
    costruction_costs_per_sf_parking=construction_cost_per_sf_parking,
    sale_price_per_sf=sale_price_per_sf,
    rent_price_per_sf=rent_per_sf_2,
    cap_rate=cap_rate_2,
    net_coef=net_coefficient,
    json_file_path=path)  # -> values
# ---------- python_3: Python ----------
__author__ = "ilouh"
__version__ = "2023.02.21"

import rhinoscriptsyntax as rs
import Grasshopper as gh
import Rhino.Geometry as rg
import ghpythonlib.components as comps
import math



def format_to_dollar_price(value):
    if isinstance(value, (int, float)):
        formatted_value = "${:,.2f}".format(value)
    elif isinstance(value, str):
        # Remove any non-numeric characters
        value = ''.join(filter(str.isdigit, value))
        if value:
            formatted_value = "${:,.2f}".format(float(value)/100)
        else:
            formatted_value = "$0.00"
    else:
        raise TypeError("Unsupported value type. Only int, float, and str are supported.")
    
    return formatted_value

def float_to_percentage(number):
    percentage = number * 100
    formatted_percentage = "{:.2f}%".format(percentage)
    return formatted_percentage

#_______________________________________________________________________________________

# Create a dictionary to store the calculated values

data_dict = {

    'hard_vs_soft_coef': float_to_percentage(hard_soft_coef/100),
    'costruction_costs_per_sf': format_to_dollar_price(costruction_costs_per_sf),
    'costruction_costs_per_sf_parking': format_to_dollar_price(costruction_costs_per_sf_parking),
    'sale_price_per_sf': format_to_dollar_price(sale_price_per_sf),
    'rent_price_per_sf': format_to_dollar_price(rent_price_per_sf),
    'cap_rate': float_to_percentage(cap_rate/100),
    'net_vs_gross_coef': float_to_percentage(net_coef/100)
}

# Create a dataframe from the dictionary

values = []

keys_list = [

    'costruction_costs_per_sf',
    'costruction_costs_per_sf_parking',
    'sale_price_per_sf',
    'rent_price_per_sf',
    'cap_rate',
    'net_vs_gross_coef',
    'hard_vs_soft_coef'
]

for item in keys_list:
    values.append(item + ': ' + str(data_dict[item]))
    

import json


with open(json_file_path) as f:
    data = json.load(f)

data['json_schema']['assumptions'] = data_dict

#save the json file
with open(json_file_path, 'w') as outfile:
    json.dump(data, outfile)
# ---------- end python_3 ----------
panel_5 = Panel("""3
5""")
ins_3 = InsertItems(List=python_3, Indices=panel_5, Wrap=True)
panel_6 = Panel(ins_3)

cluster = Cluster(
    massing=massing,
    typical_floor_height=typical_floor_height,
    bool=omit_last_floor_slab,
    total_parking_area=total_parking_area,
    cpsf=construction_cost_per_sf_2,
    cpsf_parking=construction_cost_per_sf_parking,
    ppsf=sale_price_per_sf,
    rpsf=rent_per_sf_2,
    cap_rate=cap_rate_2,
    net_coef=net_coefficient,
    land_value=land_value,
    hard_soft_coef=hard_vs_soft_coef,
    json_file_path=path)  # -> facade_attributes_2, points_facade_attributes, walls_2, roof, floors_2, floor_plate_curves, L

panel_7 = Panel(cluster.L)

output_floors = Brep(cluster.floors_2)

# ---- group: Output - Walls
walls = Surface(simplify(cluster.walls_2))

# ----
output_roof = Brep(cluster.roof)

# ---- group: Output - Floors As Curve
crv = Curve(cluster.floor_plate_curves)

# ----
preview = CustomPreview(Geometry=cluster.walls_2, Material=ColourSwatch(SwatchColor=RGBA(191, 191, 191, 126)))  # disabled
preview_2 = CustomPreview(Geometry=output_roof, Material=ColourSwatch(SwatchColor=RGB(125, 125, 125)))  # disabled
preview_3 = CustomPreview(Geometry=output_floors, Material=ColourSwatch(SwatchColor=RGB(164, 212, 126)))  # disabled
screentext = ScreenOrientedText(
    Text=cluster.facade_attributes_2,
    Font="Ariel",
    Justification=7,
    Location=cluster.points_facade_attributes,
    SizeFactor=10,
    Depth=0,
    Absolute=False)
output = DataOutput(
    DataInput=walls,
    Destination="C:\Volumes\GoogleDrive-113227027081246915491\My Drive\Scripting Repository\Exchange Data\FacadeWalls_comm.ghdata",
    RelativePath="C:\Volumes\GoogleDrive-113227027081246915491\My Drive\Scripting Repository\Exchange Data\FacadeWalls_comm.ghdata|..\..\..\..\..\Volumes\GoogleDrive-113227027081246915491\My Drive\Scripting Repository\Exchange Data\FacadeWalls_comm.ghdata")
output_2 = DataOutput(
    DataInput=output_roof,
    Destination="C:\Volumes\GoogleDrive-113227027081246915491\My Drive\Scripting Repository\Exchange Data\Roof_comm.ghdata",
    RelativePath="C:\Volumes\GoogleDrive-113227027081246915491\My Drive\Scripting Repository\Exchange Data\Roof_comm.ghdata|..\..\..\..\..\Volumes\GoogleDrive-113227027081246915491\My Drive\Scripting Repository\Exchange Data\Roof_comm.ghdata")
output_3 = DataOutput(
    DataInput=output_floors,
    Destination="C:\Volumes\GoogleDrive-113227027081246915491\My Drive\Scripting Repository\Exchange Data\Floors_comm.ghdata",
    RelativePath="C:\Volumes\GoogleDrive-113227027081246915491\My Drive\Scripting Repository\Exchange Data\Floors_comm.ghdata|..\..\..\..\..\Volumes\GoogleDrive-113227027081246915491\My Drive\Scripting Repository\Exchange Data\Floors_comm.ghdata")

# ==== cluster Cluster
massing = ClusterInput()
typical_floor_height = ClusterInput()
massing_2 = Brep(graft(massing))
typical_floor_height_2 = Integer(typical_floor_height)

# ---- group: Calculates Building Height
bbox = BoundingBox(Content=massing_2, Plane=PlaneXY(0, 0, 0), UnionBox=True)  # -> Box, Box_2
box_corners = BoxCorners(Box=bbox.Box)  # -> CornerA, CornerB, CornerC, CornerD, CornerE, CornerF, CornerG, CornerH

# ----
Z = UnitZ(Factor=1)
contour = Contour(Shape=massing_2, Point=box_corners.CornerA, Direction=Z, Distance=typical_floor_height_2)  # -> simplify(Contours)
panel = Panel(contour)
floors_as_curves = Curve(contour)

# ---- group: Isolate Faces of Mass
debrep = DeconstructBrep(Brep=massing_2)  # -> Faces, Edges, Vertices
evalsrf = EvaluateSurface(Surface=reparameterize(debrep.Faces), Point="{0.5,0.5,0}")  # -> Point, Normal, UDirection, VDirection, Frame
distributefaces = GhPythonScript(v=evalsrf.Normal, faces=debrep.Faces)  # -> floors, facadeWalls, roof; inputs v: list, faces: list
# ---------- distributefaces: Python ----------
__author__ = "ilouh"
__version__ = "2023.01.08"

import rhinoscriptsyntax as rs
import ghpythonlib.components as comps
import Rhino.Geometry as geom

#elements = comps.DeconstructBrep(mass)
#faces = elements['faces']

#find the normal of each face


roof = []
floors = []
solidWalls = []
facadeWalls = [] 

for i in range(0,len(v)):
    
    
    values = comps.DeconstructVector(v[i])
    print(values)
    
    x_value = values['x_component']
    y_value = values['y_component']
    z_value = values['z_component']
    
    

    if z_value >= 0.4:
        
        print(i)
        roof.append(faces[i])
    
    if z_value == -1:
        
        floors.append(faces[i])
   
    if abs(z_value) != 1:
    
        facadeWalls.append(faces[i])
# ---------- end distributefaces ----------

# ---- group: Pass if Tree or List
flatten = FlattenTree(Tree=floors_as_curves, Path="{0}")
python = GhPythonScript(x=flatten)  # -> a; inputs x: list
# ---------- python: Python ----------
__author__ = "ilouh"
__version__ = "2023.02.21"

import rhinoscriptsyntax as rs
import Grasshopper as gh
import Rhino.Geometry as rg
import ghpythonlib.components as comps
import math

if len(x) > 1:
    a = True
else:
    a = False
# ---------- end python ----------
trim = TrimTree(Tree=floors_as_curves, Depth=1)
flatten_2 = FlattenTree(Tree=floors_as_curves, Path="{0}")
filter = StreamFilter(Gate=python, Stream0=flatten_2, Stream1=trim)

# ----
cls = Closed(Curve=filter)  # -> Closed, Periodic
panel_2 = Panel(cls.Closed)
cull = CullPattern(List=filter, CullPattern=cls.Closed)
srf = Surface(graft(distributefaces.facadeWalls))
srf_2 = Surface(flatten(distributefaces.roof))
srf_3 = Surface(distributefaces.floors)
flatten_3 = FlattenTree(Tree=srf_3, Path="{0}")
trim_2 = TrimTree(Tree=srf, Depth=1)
area = Area(Geometry=flatten_3)  # -> Area, Centroid
bool = ClusterInput()
ma = MassAddition(Input=area.Area)  # -> Result, PartialResults

# ---- group: Calculates Gross Building Area
python_2 = GhPythonScript(Floor_Plate_Curves=cull, bool=bool)  # -> keys, simplify(values), TotalBuildingArea, Floor_Plate_Curves; inputs Floor_Plate_Curves: list of Curve, floorList: list of Int32
# ---------- python_2: Python ----------
__author__ = "Iliya Muzychuk"
__version__ = "2023.02.03"

import rhinoscriptsyntax as rs
import Grasshopper as gh
import Rhino.Geometry as rg
import ghpythonlib.components as comps

FloorNames = []
FloorAreas = []

#Funcition to find the key of a dictionary by value 

def findKey(value_to_find,dic):
    for key, value in dic.items():
        if abs(value - value_to_find) < 2:
            return key
dic = {}
#Create a name and claculates the area of each floor
for i in range(0,len(floorList)):
    floor_number = 1 + i
    dic_name = 'Floor {}'.format(floor_number)
    dic[dic_name] = floorList[i]

print(dic)

if bool == True: 

    Floor_Plate_Curves.pop(-1)

else:
    
    pass

for  floor in Floor_Plate_Curves: 
    
    
    Floor_Area = comps.Area(floor)
    FloorAreas.append(round(Floor_Area['area'],2))

    
    z_value = int(Floor_Area['centroid'][2])
    print(z_value)
    Floor_Name = findKey(z_value,dic)
    
    print(Floor_Name)

    FloorNames.append(Floor_Name)

keys = FloorNames
values = FloorAreas

TotalBuildingArea = sum(values)
# ---------- end python_2 ----------

# ---- group: creates the extrusion distance
floor_thickness = Slider(0.5, range=0..1)
neg = Negative(Value=floor_thickness)
Z_2 = UnitZ(Factor=neg)
extr = Extrude(Base=python_2.Floor_Plate_Curves, Direction=Z_2)
cap = CapHoles(Brep=extr)

# ----
json_file_path = ClusterInput()
total_parking_area = ClusterInput()
cpsf = ClusterInput()
cpsf_parking = ClusterInput()
ppsf = ClusterInput()
rpsf = ClusterInput()
cap_rate = ClusterInput()
net_coef = ClusterInput()
land_value = ClusterInput()
hard_soft_coef = ClusterInput()
tstat = TreeStatistics(Tree=python_2.values)  # -> Paths, Length, Count
flatten_4 = FlattenTree(Tree=python_2.values, Path="{0}")
panel_3 = Panel(python_2.TotalBuildingArea)
python_3 = GhPythonScript(
    areas=flatten_4,
    total_parking_area=total_parking_area,
    length_tree=tstat.Paths,
    cpsf=cpsf,
    cpsf_parking=cpsf_parking,
    ppsf=ppsf,
    rpsf=rpsf,
    cap_rate=cap_rate,
    net_coef=net_coef,
    land_value=land_value,
    hard_soft_coef=hard_soft_coef,
    json_file_path=json_file_path)  # -> total_area, total_units, average_unit_size, average_unit_rent, average_unit_sale_value, land_value, construction_cost, soft_costs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; inputs areas: list, length_tree: list
# ---------- python_3: Python ----------
__author__ = "ilouh"
__version__ = "2023.02.21"

import rhinoscriptsyntax as rs
import Grasshopper as gh
import Rhino.Geometry as rg
import ghpythonlib.components as comps
import math

#sum a list of numbers
def sum(numbers):
    total = 0
    for n in numbers:
        total += n
    return total


units = len(length_tree)
total_area = sum(areas)

#Functions
def format_to_dollar_price(value):
    if isinstance(value, (int, float)):
        formatted_value = "${:,.2f}".format(value)
    elif isinstance(value, str):
        # Remove any non-numeric characters
        value = ''.join(filter(str.isdigit, value))
        if value:
            formatted_value = "${:,.2f}".format(float(value)/100)
        else:
            formatted_value = "$0.00"
    else:
        raise TypeError("Unsupported value type. Only int, float, and str are supported.")
    
    return formatted_value

def float_to_percentage(number):
    percentage = number * 100
    formatted_percentage = "{:.2f}%".format(percentage)
    return formatted_percentage

def format_to_sf_area(value):
    if isinstance(value, (int, float)):
        formatted_value = "{:,.2f} SF".format(value)
    else:
        raise TypeError("Unsupported value type. Only int and float are supported.")
    
    return formatted_value

#_______________________________________________________________________________________
# Calculations
average_unit_size = total_area / units  # Average size of each unit in square feet
average_rent = float(rpsf) * total_area / units  # Average monthly rent per unit
unit_sale_value = average_unit_size * ppsf  # Sale value of each unit

project_valuation = (average_rent * units * (net_coef / 100) * 12) / (cap_rate / 100)  # Valuation of the project based on net operating income
construction_costs = total_area * cpsf  # Total construction costs for the project
soft_costs = construction_costs * ((100 - hard_soft_coef) / 100)  # Soft costs for the project
total_project_costs = land_value + construction_costs + soft_costs  # Total costs for the project

net_income = total_area * rpsf * (net_coef/100) * 12 

# Create a dictionary to store the calculated values
data_dict = {
    'total__buildbale_area': format_to_sf_area(total_area),
    'total_parking_area': format_to_sf_area(total_parking_area),
    'total_units': units,
    'average_unit_size': format_to_sf_area(average_unit_size),
    'average_unit_rent': format_to_dollar_price(average_rent),
    'average_unit_sale_value': format_to_dollar_price(unit_sale_value),
    'land_value': format_to_dollar_price(land_value),
    'construction_cost': format_to_dollar_price(total_area * cpsf + total_parking_area * cpsf_parking),
    'soft_costs': format_to_dollar_price(soft_costs),
    'total_cost': format_to_dollar_price(total_project_costs),
    'sale_value': format_to_dollar_price(total_area * ppsf),
    'project_valuation': format_to_dollar_price(project_valuation),
    'gross_profit': format_to_dollar_price(total_area * ppsf - total_project_costs),
    'gross_margin': float_to_percentage((total_area * ppsf - total_project_costs) / (total_area * ppsf)),
    'gross_income' : format_to_dollar_price(total_area * rpsf * 12) ,
    'net_income' : format_to_dollar_price(net_income)
}

# Create a list of keys to iterate through
keys_list = [
    'total__buildbale_area',
    'total_parking_area',
    'total_units',
    'average_unit_size',
    'average_unit_rent',
    'average_unit_sale_value',
    'land_value',
    'construction_cost',
    'soft_costs',
    'total_cost',
    'sale_value',
    'project_valuation',
    'gross_profit',
    'gross_margin',
    'gross_income',
    'net_income'
]

# Iterate through the keys_list and retrieve corresponding values from the data_dict
values = []
for item in keys_list:
    values.append(item + ': ' + str(data_dict[item]))

# Print the values
print(values)



import json

with open(json_file_path) as f:
    data = json.load(f)

data['json_schema']['proforma'] = data_dict

#save the json file
with open(json_file_path, 'w') as outfile:
    json.dump(data, outfile)
# ---------- end python_3 ----------
walls = Surface(simplify(trim_2))

extr_2 = Extrude(Base=srf_2, Direction=Z_2)
cap_2 = CapHoles(Brep=extr_2)

floors = Brep(simplify(cap))
panel_4 = Panel(python_3.values)

# ---- group: Outputs
floor_plate_curves = ClusterOutput(python_2.Floor_Plate_Curves)
floors_2 = ClusterOutput(floors)
walls_2 = ClusterOutput(walls)
roof = ClusterOutput(cap_2)

# ----
flatten_5 = FlattenTree(Tree=python_2.TotalBuildingArea, Path="{0}")
panel_5 = Panel("""3
6
10
13""")
graft = GraftTree(Tree=flatten_5, IncludeEmptyLists=True, IncludeNullItems=True)

# ---- group: Calculates Wall Area Ratio
python_4 = GhPythonScript(walls=walls, totalBuildingArea=graft)  # -> keys, values, result; inputs walls: list
# ---------- python_4: Python ----------
__author__ = "Iliya Muzychuk"
__version__ = "2023.02.03"

import rhinoscriptsyntax as rs
import Grasshopper as gh
import Rhino.Geometry as rg
import ghpythonlib.components as comps

#A function to convert a float to percentage

def float_to_percentage(number):
    return '{:.2%}'.format(number)
    
wall_areas = []

for wall in walls:
    
    area = rs.Area(wall)
    wall_areas.append(area)

total_wall_area = round(sum(wall_areas),2)
wall_area_ratio = total_wall_area / totalBuildingArea

#Dictionary constructions allows future json file control 

dic = {

    'Total Facade Area' : total_wall_area,
    'Wall area/Floor area Ratio' : float_to_percentage(wall_area_ratio)

}

keys = dic.keys()
values = dic.values() 

result = []

for key, value in dic.items():
    
    string = str(key) + ": " + str(value)
    result.append(string)
# ---------- end python_4 ----------

# ----
ins = InsertItems(List=panel_4, Indices=panel_5, Wrap=True)
L = ClusterOutput(ins)
facade_attributes = Data(python_4.result)

lng = ListLength(List=simplify(facade_attributes))
series = Series(Start=0, Step=typical_floor_height_2, Count=lng)

Z_3 = UnitZ(Factor=series)
move = Move(Motion=Z_3)  # -> Points_Facade_Attributes, Transform

points_facade_attributes = ClusterOutput(move.Points_Facade_Attributes)
facade_attributes_2 = ClusterOutput(facade_attributes)
